# Dynamo graph SampleWorkflow.dyn (Dynamo 1.3.2.2480)

number = DoubleInput(5)

# group: Point Coordinates
byCoordinates = Point.ByCoordinates()
number_2 = DoubleInput(10)
byCoordinates_2 = Point.ByCoordinates(x=number_2)
number_3 = DoubleInput(5)
byCoordinates_3 = Point.ByCoordinates(z=number_3)
byCoordinates_4 = Point.ByCoordinates(y=number_2)
number_4 = DoubleInput(15)
byCoordinates_5 = Point.ByCoordinates(x=number_4, y=number_4)
number_5 = DoubleInput(10)
byCoordinates_6 = Point.ByCoordinates(x=number, y=number_5, z=number_5)
number_6 = DoubleInput(-2)
number_7 = DoubleInput(5)
byCoordinates_7 = Point.ByCoordinates(x=number_6, y=number_7)

# group: Create arcs
byStartPointEndPoint = Line.ByStartPointEndPoint(startPoint=byCoordinates, endPoint=byCoordinates_2)
byThreePoints = Arc.ByThreePoints(firstPoint=byCoordinates, secondPoint=byCoordinates_3, thirdPoint=byCoordinates_2)
create = List.Create(byStartPointEndPoint, byThreePoints)
byJoinedCurves = PolyCurve.ByJoinedCurves(create)
byStartPointEndPoint_2 = Line.ByStartPointEndPoint(startPoint=byCoordinates_4, endPoint=byCoordinates_5)
byThreePoints_2 = Arc.ByThreePoints(firstPoint=byCoordinates_4, secondPoint=byCoordinates_6, thirdPoint=byCoordinates_5)
create_2 = List.Create(byStartPointEndPoint_2, byThreePoints_2)
byJoinedCurves_2 = PolyCurve.ByJoinedCurves(create_2)
create_3 = List.Create(byJoinedCurves, byJoinedCurves_2)

# group: Create loft path
create_4 = List.Create(byCoordinates, byCoordinates_7, byCoordinates_4)
byPoints = NurbsCurve.ByPoints(create_4)

# group: Create solids by loft
# note: Tip:  Turn off "Preview" in Node Right Click menus to exclude elements from Showing
byLoft = Solid.ByLoft(create_3, byPoints)
# note: Multiple creation methods exist for most Solids.  These examples show Closed Profiles as the base, but polysurfaces can be stitched, many primitives are available (Surfaces, Cuboid, Cone, etc)
byLoft_2 = Solid.ByLoft(create_3)

# group: Translate solid #2
code_block = CodeBlock { Vector.ByCoordinates(-20,0,0); }
translate = Geometry.Translate(geometry=byLoft, direction=code_block)

# group: Create shell from solid #1
code_block_2 = CodeBlock { 0; }
# note: Tip:  Turn off "Preview" in Node Right Click menus to exclude elements from Showing
thinShell = Solid.ThinShell(byLoft_2, code_block_2)

# group: Translate shell
code_block_3 = CodeBlock { Vector.ByCoordinates(20,0,0); }
translate_2 = Geometry.Translate(geometry=thinShell, direction=code_block_3)

ZAxis = Vector.ZAxis()

# group: Cut shell
code_block_4 = CodeBlock { Point.ByCoordinates(0,0,5); }
# note: Geometric Boolean operations (Intersect, Difference, Union, Etc) are available in the Geometry Category.
byOriginNormal = Plane.ByOriginNormal(origin=code_block_4, normal=ZAxis)
code_block_5 = CodeBlock { Point.ByCoordinates(10,10,10); }
trim = Geometry.Trim(geometry=translate_2, other=byOriginNormal, pick=code_block_5)
